# Grasshopper definition GH_Challenges_E_representation.ghx (Grasshopper 1.0.7)
# plug-ins: Human

point = Point([Point(519.6830882, 303.3329789, 0), Point(479.1816793, 181.0645749, 0), Point(530.3815735, 84.01402912, 0), Point(496.7577624, -9.215629, 0)])
# Challenge E7. Using only the components present, create a custom 'dotted line', made of circles that change in size and color. Bake them to a hatch. In Rhino, export the hatch as an Illustrator .AI file, and open in Illustrator!
interpolate = Interpolate(Vertices=point, Degree=3, Periodic=False, KnotStyle=1)  # -> Curve, Length, Domain
# Challenge E1: We need to bake a sphere, but this 90s neon green will simply not do. Change the color and bake the sphere.
construct_point = ConstructPoint(XCoordinate=0, YCoordinate=0, ZCoordinate=0)
# Challenge E2: Great, but we need more fine-tuned control; change the color with the 'Colour RGB (f)' component and bake another sphere.
construct_point_2 = ConstructPoint(XCoordinate="100", YCoordinate=0, ZCoordinate=0)
# Grasshopper Challenges
# By Dan Taeyoung, 2016. https://github.com/provolot/GrasshopperChallenges
# Challenges E - Grasshopper as representation tool
# Required Plugins: Human
# Challenge E0: Let's bake on command. Using the slider, bake only two circles: a circle with diameter 10, and with diameter 20.
construct_point_3 = ConstructPoint(XCoordinate="-100", YCoordinate=0, ZCoordinate=0)
series = Series(Start=0, Step=Slider(33, range=0..100), Count=10)
# Challenge E3: We have ten spheres, but no reason why they should all be the same color. Add one 'Series' component and one 'Slider' to the Colour RGB (f) component, in order to create ten spheres that have all different colors. Bake them.
panel = Panel("200")
series_2 = Series(Start=0, Step=Slider(33, range=0..100), Count=Slider(10, range=0..20))
# Challenge E4. Let's have more free-form control over our color changes. Edit the gradient tool and bake a set of new spheres.
panel_2 = Panel("300")
series_3 = Series(Start=0, Step=Slider(33, range=0..100), Count=10)
# Challenge E7. 'Contour' lets us create a custom hatch pattern of sorts, by slicing geometry into lines. Challenge: Is it possible to make each set of lines for each polygon a different color?
panel_3 = Panel("700")
# Challenge E5. Without adding any components, increase the number of circles to 20. Make sure to adjust the Gradient component's Lower limit and Upper limit to make this happen!
panel_4 = Panel("300")
# Challenge E6. Let's try using Hatches - bake a hatch with a given color. (Hatches, upon export to Illustrator, they create colored geometry. This allows you to have fine-tuned control over Illustrator geometry.)
panel_5 = Panel("400")
curve = Curve(interpolate.Curve)
construct_point_4 = ConstructPoint(XCoordinate=panel_3, YCoordinate=0, ZCoordinate=0)
construct_point_5 = ConstructPoint(XCoordinate=panel_5, YCoordinate=0, ZCoordinate=0)
construct_point_6 = ConstructPoint(XCoordinate=panel, YCoordinate=series, ZCoordinate=0)
sphere = Sphere(Base=construct_point, Radius=Slider(8, range=0..100))
sphere_2 = Sphere(Base=construct_point_2, Radius=Slider(8, range=0..100))
construct_point_7 = ConstructPoint(XCoordinate=panel_2, YCoordinate=series_2, ZCoordinate=0)
# Explanation: Some components below are from the "Human" plugin. If you don't see anything, or if Grasshopper gave you a warning when you opened this file, install the Human plugin at:
# 
# http://food4rhino.com/project/human
circle = Circle(Plane=construct_point_3, Radius=Slider(13, range=0..30))
construct_point_8 = ConstructPoint(XCoordinate=panel_4, YCoordinate=series_3, ZCoordinate=0)
series_4 = Series(Start=0, Step=1, Count=Slider(10, range=0..10))
colour_swatch = ColourSwatch(SwatchColor=RGB(106, 250, 0))
number_slider = Slider(12, range=0..20)
circle_2 = Circle(Plane=construct_point_4, Radius=Slider(51, range=0..100))
sphere_3 = Sphere(Base=construct_point_6, Radius=Slider(9, range=0..100))

# ----
# Explanation: This is a really helpful process. The first component gets the 'bounds' or the minimum and maximum values of the data it receives, and the second one breaks it down into two numbers.
# 
# This way, we can get the Lower limit and Upper limit for the gradient component  programatically.
bounds = Bounds(Numbers=series_4)
deconstruct_domain = DeconstructDomain(Domain=bounds)  # -> Start, End

circle_3 = Circle(Plane=construct_point_5, Radius=Slider(22, range=0..100))
# Explanation: The gradient tool converts numbers (Parameter) to colors, using the lower limit as the left-most color, and the upper limit as the right-most color.
# 
# So, for the example below, entering 0 returns pink, 10 returns blue, and 5 returns a purpleish color.
# 
# You can edit the gradient by dragging the white dots, or right-clicking on them.
sphere_4 = Sphere(Base=construct_point_7, Radius=Slider(9, range=0..100))
sphere_5 = Sphere(Base=construct_point_8, Radius=Slider(9, range=0..100))
series_5 = Series(Start=0, Step=1, Count=Slider(10, range=0..10))
divide_curve = DivideCurve(Curve=curve, Count=Slider(20, range=0..100), Kinks=False)  # -> Points, Tangents, Parameters

# ---- group: Notice the '(f)' after the name - that means that it receives 'floating point numbers' from 0.0 to 1.0
colour_rgb_f = ColourRGBF(Alpha=Slider(1, range=0..1), Red=Slider(1, range=0..1), Green=Slider(1, range=0..1), Blue=Slider(1, range=0..1))

# ---- group: This very similarly named component, without the '(f)', uses numbers from 0 to 255.
colour_rgb = ColourRGB(Alpha=Slider(0, range=0..255), Red=Slider(0, range=0..255), Green=Slider(0, range=0..255), Blue=Slider(0, range=0..255))

# ----
divide_curve_2 = DivideCurve(Curve=circle_2, Count=number_slider, Kinks=False)  # -> Points, Tangents, Parameters

# ---- group: Notice the '(f)' after the name - that means that it receives 'floating point numbers' from 0.0 to 1.0
colour_rgb_f_2 = ColourRGBF(Alpha=1, Red=Slider(1, range=0..1), Green=Slider(1, range=0..1), Blue=Slider(1, range=0..1))

# ----
panel_6 = Panel(bounds)
gradient = Gradient(
    LowerLimit=Slider(0, range=0..10),
    UpperLimit=Slider(10, range=0..10),
    Parameter=series_5,
    stops=[0.15: RGB(255, 130, 160), 0.817: RGB(51, 128, 189)])
series_6 = Series(Start=Slider(3, range=3..5), Step=Slider(1, range=0..5), Count=number_slider)
colour = Colour(ColourSwatch(SwatchColor=RGB(195, 74, 255)))
# Explanation: The two components below are from the "Human" plugin. If you don't see anything, or if Grasshopper gave you a warning when you opened this file, install the Human plugin at:
# 
# http://food4rhino.com/project/human
gradient_2 = Gradient(
    LowerLimit=deconstruct_domain.Start,
    UpperLimit=deconstruct_domain.End,
    Parameter=series_4,
    stops=[0: RGB(42, 198, 17), 0: RGB(243, 57, 0), 0.1: RGB(236, 27, 60), 0.2: RGB(210, 0, 118), 0.3: RGB(103, 0, 120), 0.4: RGB(39, 72, 161), 0.5: RGB(1, 192, 229), 0.6: RGB(18, 178, 90), 0.7: RGB(79, 186, 8), 0.8: RGB(220, 237, 32), 0.9: RGB(247, 159, 20), 1: RGB(243, 57, 0)])
addition = Addition(A=series_6, B=Slider(2.05, range=0..5))
number_slider_2 = Slider(0.5, range=0..1)
number_slider_3 = Slider(1, range=0..1)
bounds_2 = Bounds()

# ---- group: Click the 'False' to change it to 'True' and bake geometry!
# Explanation: Make sure to turn this back off! Otherwise any changes will continuously bake copies.
boolean_toggle = BooleanToggle(False)

# ----
list_length = ListLength()

# ---- group: Make sure to turn this back off! Otherwise any changes will continuously bake copies.
boolean_toggle_2 = BooleanToggle(False)

# ----
polygon = Polygon(Plane=divide_curve_2.Points, Radius=addition, Segments=series_6, FilletRadius=0)  # -> Polygon, Length
gradient_3 = Gradient(LowerLimit=0, UpperLimit=1, stops=[0.00568: RGB(48, 194, 255), 1: RGB(0, 0, 0)])

# ---- group: Make sure to turn this back off! Otherwise any changes will continuously bake copies.
boolean_toggle_3 = BooleanToggle(False)

# ----
series_7 = Series(Start=0, Step=1, Count=10)

# ---- group: The 'CreateHatch' and 'CreateAttributes' components are from the "Human" plugin.
text = Text("Solid")
boolean = Boolean(Toggle(False))
curve_2 = Curve(circle_3)
createattributes = CreateAttributes(Color=colour, enableFullPath=False)
createhatch = CreateHatch(Bake=boolean, Curves=curve_2, HatchPatternName=text, HatchScale=1, HatchRotation=0, Attributes=createattributes)  # -> HatchGeometry, HatchObjects

# ----
circle_4 = Circle(Plane=divide_curve.Points, Radius=Slider(6, range=0..10))
colour_2 = Colour(gradient)
createattributes_2 = CreateAttributes(Color=colour_swatch, enableFullPath=False)

# ----
# (There are actually many components in other plugins that do baking, including in Lunchbox, Human, Elefront among others. These baking components are from Human.)
createattributes_3 = CreateAttributes(enableFullPath=False)
bake_geometry = BakeGeometry(Bake=boolean_toggle, Geometry=circle, Attributes=createattributes_3, DeleteOldBakes=False, PreserveTrees=False)

deconstruct_domain_2 = DeconstructDomain()  # -> Start, End
createattributes_4 = CreateAttributes(Color=colour_rgb_f, enableFullPath=False)
colour_3 = Colour(colour_rgb_f_2)
custom_preview = CustomPreview(Geometry=sphere, Shader=colour_swatch)
geometry = Geometry(polygon.Polygon)
custom_preview_2 = CustomPreview(Geometry=sphere_2, Shader=colour_rgb_f)

# ---- group: Make sure to turn this back off! Otherwise any changes will continuously bake copies.
boolean_toggle_4 = BooleanToggle(False)

# ----
custom_preview_3 = CustomPreview(Geometry=sphere_3, Shader=colour_3)
createattributes_5 = CreateAttributes(Color=colour_3, enableFullPath=False)
custom_preview_4 = CustomPreview(
    Geometry=sphere_4,
    Shader={diffuse=RGB(255, 105, 180), emission=RGB(76, 32, 54), shine=0.5, specular=RGB(255, 255, 255), transparency=0})
colour_4 = Colour(gradient_2)
bake_geometry_2 = BakeGeometry(Bake=boolean_toggle_2, Geometry=sphere, Attributes=createattributes_2, DeleteOldBakes=False, PreserveTrees=False)

# ---- group: Make sure to turn this back off! Otherwise any changes will continuously bake copies.
boolean_toggle_5 = BooleanToggle(False)

# ----
checker = Checker_2(data=circle)
bake_geometry_3 = BakeGeometry(Bake=boolean_toggle_3, Geometry=sphere_2, Attributes=createattributes_4, DeleteOldBakes=False, PreserveTrees=False)
createattributes_6 = CreateAttributes(Color=colour_2, enableFullPath=False)
checker_2 = Checker(colour=colour_3)
# Hint:
# If you're not seeing 'Correct!', make sure that you _really_ have only two lines.
panel_7 = Panel(checker)
bake_geometry_4 = BakeGeometry(Bake=boolean_toggle_4, Geometry=sphere_3, Attributes=createattributes_5, DeleteOldBakes=False, PreserveTrees=False)
custom_preview_5 = CustomPreview(Geometry=sphere_5, Shader=colour_4)
bake_geometry_5 = BakeGeometry(Bake=boolean_toggle_5, Geometry=sphere_4, Attributes=createattributes_6, DeleteOldBakes=False, PreserveTrees=False)

# ---- group: Make sure to turn this back off! Otherwise any changes will continuously bake copies.
boolean_toggle_6 = BooleanToggle(False)

# ----
createattributes_7 = CreateAttributes(Color=colour_4, enableFullPath=False)
panel_8 = Panel(checker_2)

# ---- group: The 'Contour' component needs as input a point that is near the geometry that you are Contouring.
point_2 = Point(construct_point_4)

# ----
vector_xyz = VectorXYZ(XComponent=Slider(1, range=0..1), YComponent=Slider(1, range=0..1), ZComponent=0)  # -> Vector, Length
geometry_2 = Geometry(circle_4)
colour_5 = Colour(ColourSwatch(SwatchColor=RGB(51, 255, 255)))
bake_geometry_6 = BakeGeometry(Bake=boolean_toggle_6, Geometry=sphere_5, Attributes=createattributes_7, DeleteOldBakes=False, PreserveTrees=False)
createattributes_8 = CreateAttributes(enableFullPath=False)
boundary_surfaces = BoundarySurfaces(Edges=geometry_2)

# ---- group: As a note, there are four different 'Contour' components that look similar. Take care when you're placing this component!
# Explanation: The 'Contour' component slices geometry and generates lines. If you Contour a 2d object, it creates a set of lines; if you Contour a 3d object, it will generate a set of closed polylines representing a plane.
contour = Contour(Shape=geometry, Point=point_2, Direction=vector_xyz.Vector, Distance=Slider(1.866, range=1..5))

# ----
bake_geometry_7 = BakeGeometry(Bake=False, Attributes=createattributes_8, DeleteOldBakes=False, PreserveTrees=False)
# Hint:
custom_preview_6 = CustomPreview(Geometry=boundary_surfaces, Shader=colour_5)
boolean_2 = Boolean(Toggle(False))

# ---- group: The 'CreateHatch' and 'CreateAttributes' components are from the "Human" plugin.
createattributes_9 = CreateAttributes(Color=colour_5, enableFullPath=False)
# Challenge E5 may be a good reference to how to use the Gradient and Bounds components together.
createhatch_2 = CreateHatch(
    Bake=boolean_2,
    Curves=geometry_2,
    HatchPatternName="Solid",
    HatchScale=1,
    HatchRotation=0,
    Attributes=createattributes_9)  # -> HatchGeometry, HatchObjects

# ----
custom_preview_7 = CustomPreview(
    Geometry=contour,
    Shader={diffuse=RGB(255, 105, 180), emission=RGB(76, 32, 54), shine=0.5, specular=RGB(255, 255, 255), transparency=0})
geometry_3 = Geometry(createhatch_2.HatchGeometry)

# ==== cluster Checker
colour = ClusterInput()
split_argb = SplitARGB(Colour=colour)  # -> Alpha, Red, Green, Blue
relative_differences = RelativeDifferences(Values=split_argb.Red)
relative_differences_2 = RelativeDifferences(Values=split_argb.Green)
relative_differences_3 = RelativeDifferences(Values=split_argb.Blue)
average = Average(Input=relative_differences)
average_2 = Average(Input=relative_differences_2)
average_3 = Average(Input=relative_differences_3)
mass_addition = MassAddition(Input=[average, average_2, average_3])  # -> Result, PartialResults
larger_than = LargerThan(FirstNumber=mass_addition.Result, SecondNumber="0.001")  # -> LargerThan, OrEqualTo
stream_filter = StreamFilter(Gate=larger_than.LargerThan, Stream0=" ", Stream1="Correct!")
data = Data(stream_filter)
data_2 = ClusterOutput(data)
panel = Panel(mass_addition.Result)

# ==== cluster Checker_2
data = ClusterInput()
data_2 = Data(data)
geometry_pipeline = GeometryPipeline(
    GroupByLayer=False,
    GroupByType=False,
    IncludeHidden=True,
    IncludeLocked=True,
    LayerFilter="*",
    NameFilter="*",
    SublayerFiltering=False,
    TypeFilter=4)
boolean = Boolean(data_2)
mass_addition = MassAddition(Input=flatten(boolean))  # -> Result, PartialResults
length = Length(Curve=geometry_pipeline)
mass_addition_2 = MassAddition(Input=length)  # -> Result, PartialResults
boolean_2 = Boolean(mass_addition.Result)
pi = Pi(Factor=1)
division = Division(A=mass_addition_2.Result, B=pi)
similarity = Similarity(FirstNumber=Slider(60, range=0..100), SecondNumber=division, Threshold=0.1)  # -> Similarity, AbsoluteDifference
panel = Panel(division)
gate_and = GateAnd(A=boolean_2, B=similarity.Similarity)
stream_filter = StreamFilter(Gate=gate_and, Stream0=" ", Stream1="Correct!")
data_3 = Data(stream_filter)
data_4 = ClusterOutput(data_3)
